vi "Spectrum Monitor.gvi"   [LabVIEW Communications System Design Software 2.0.1]
outputs:
  "LO Frequency": f64
  "Spectrum Size": i32
  "Frame Parameters Out": T5
panel controls:
  "RX Parameters In": T1 = {"IQ Sampling Rate [S/sec]"=20000000, "Gain [dB]"=0, "Reference Frequency"="", "Timebase Clock Source"="", "Start Carrier [Hz]"=50000000, "Stop Carrier [Hz]"=500000000, "Acq Duration [sec]"=0.0001, "Active Antenna"=""}
  "Device Names": "niUSRPClass"
  "Averaging Parameters": "Averaging Parameters.gtype" = {"averaging mode"="No averaging", "weighting mode"="Exponential", "number of averages"=10}  # averaging parameters defines how the averaging is computed. The specifications of the parameters include the type of averaging, the type of weighting, and the number of averages.
  "Display": T4 = {"display unit"="Vrms", "dB type"="dB"}
  "Stop Capture": bool
  "Tab": i32
  "threshold": f64
  "IQ frac": enum{"0.25", "0.5", "0.6", "0.8"} = "0.25"
panel indicators:
  "error out": error
  "Samples per Acquisition": i64
  "count": i32
  "Carrier Freq Out": f64
  "FFT Power Spectrum": cluster{"f0": f64, "df": f64, "IQ": f64[]}
  "Est. Freqs above Thresh": f64[]
  "Power at those Freqs.": f64[]
  "Carrier Queue": f64[]
  "Waterfall Plot": f64[][]
types:
  T1 = cluster{"IQ Sampling Rate [S/sec]": f64, "Gain [dB]": f64, "Reference Frequency": string, "Timebase Clock Source": string, "Start Carrier [Hz]": f64, "Stop Carrier [Hz]": f64, "Acq Duration [sec]": f64, "Active Antenna": string}
  T2 = enum{"No averaging", "Vector averaging", "RMS averaging", "Peak hold"}
  "Averaging Parameters.gtype" = cluster{"averaging mode": T2, "weighting mode": enum{"Linear", "Exponential"}, "number of averages": u32}
  T3 = enum{"Vrms", "Vpk", "Vrms^2", "Vpk^2", "Vrms/rtHz", "Vpk/rtHz", "Vrms^2/Hz", "Vpk^2/Hz"}
  T4 = cluster{"display unit": T3, "dB type": enum{"Linear", "dB", "dBm"}}
  T5 = cluster{"IQ Rate": f64, "Frames": i32, "Length of Subset": i32, "Start Carrier [Hz": f64, "Stop Carrier [Hz]": f64, "Acq Duration [Sec]": f64, "Start Index of Subset": i32}
diagram:
  call "niUSRP Open Rx Session.gvi"(niUSRP Device=$"Device Names") -> (error out=w1, session handle out=w2)
  call "Set Parameters.gvi"(RX Parameters In=$"RX Parameters In", USRP Session Handle In=w2, error in (no error)=w1, IQ frac=$"IQ frac") -> (error out: HW RX Param subsetup=w3, USRP Session Handle Out=w4, Test Carrier Frequencies=w5, Samples per Acquisition=w6, Frame Parameters Out=w7)
  Property Node(instance in=$"Averaging Parameters") -> ("number of averages"=w8, instance out=w9)
  call "niUSRP Configure Number of Samples.gvi"(session handle=w4, number of samples is finite=TRUE, number of samples=w6, error in (no error)=w3) -> (session handle out=w10, Error Out=w11)
  To Long Integer(number=w8) -> w12
  w13 = $Display
  while {
    # Restart at first carrier after end
    s1 = 0  # shift register
    for (iteration -> i1) {
      w14 = each element of w5
      call "Set Carrier and LO.gvi"(Current Frequency=w14, LO Frequency=s1, niusrp in_2=w10, error in=w11) -> (Usrp.niUSRPClass=w15, Error=w16)
      # Get new carrier frequency
      for (N = w12) (iteration -> i2) {
        # Averaging Loop
        call "Read Data.gvi"(USRP Session Handle In=w15, error in=w16, Number of Samples=w6) -> (USRP Session Handle Out=w18, error out=w19, data=w20)
        Is Equal To 0(x=i2) -> w21
        call "Establish Sub-band.gvi"(Restart Averaging=w21, Frame Parameters=w7, Averaging Parameters=w9, error in=w19, Input Baseband IQ=w20) -> (Power Spectrum averaged Subset=w22, Window Properties=w23, error out=w24, Frame Parameters Out=w25)
        # w21: First Rx for this carrier?
        Logical Or(w24, $"Stop Capture") -> w26
        append w24 to w17
        stop if w26
      }
      Merge Errors(w17) -> (error out=w27)
      Property Node(instance in=w18, error in=w27) -> ("Carrier Frequency"=w28, "LO Frequency"=w29, error out=w30, instance out=w31)
      $"Carrier Freq Out" <- w28
      $"LO Frequency" <- w29
      call "Aggregate Sub-band into Spectrum.gvi"(Frame Parameters=w25, Power Spectrum Subset=w22, Window Properties In=w23, Display=w13, Iteration=i1) -> (Waterfall Plot=w32, Spectrum to Plot=w33, Frame Parameters Out=w34, Spectrum Size=w35)
      call "Plot Spectrum.gvi"(Frame Parameters=w34, Spectrum to Plot In=w33) -> (Spectrum to Plot Out=w36, Frame Parameters out=w37)
      $"FFT Power Spectrum" <- w36
      call "Signal Power Detection_2.gvi"(Power Spectrum=w36, threshold=$threshold, Frame Parameters=w37) -> (Power at those Freqs.=w38, Est. Freqs above Thresh=w39, count=w40, sub_band_ind=w41)
      $"Est. Freqs above Thresh" <- w39
      call "Create Queue.gvi"(sub_band_ind=w41, Est. Freqs above Thresh=w39) -> (qInd ref=w42, qFreq ref=w43)
      $"Power at those Freqs." <- w38
      $count <- w40
      $"Spectrum Size" <- w35
      $"Waterfall Plot" <- w32
      next s1 = w29
      stop if w26
    }
    $"Carrier Queue" <- w5
    stop if w26
  }
  call "niUSRP Abort.gvi"(Handle in=w31, error in (no error)=w30) -> (Handle out=w44, Error Out=w45)
  call "niUSRP Close Session.gvi"(handle in=w44, error in=w45) -> (error out=w46)
  $"error out" <- w46
  Release Queue(queue=w43) -> (error out=w47)
  Release Queue(error in=w47, queue=w42) -> (error out=w48)
  call "Simple Error Handler.gvi"(error in=w48)
  $"Samples per Acquisition" <- w6
  $"Frame Parameters Out" <- w7
